# Grasshopper definition 3dBoundingBox.gh (Grasshopper 1.0.7)

box = Box({Plane=PlaneXY(-1569.111299, 24722.15888, 3249.631521), X=Domain(0, 2427.391053), Y=Domain(0, 2089.825095), Z=Domain(0, 6628.113716)})
brep = Brep(<brep referenced from the Rhino model>)
deconstruct_brep = DeconstructBrep(Brep=brep)  # -> Faces, Edges, Vertices
populate_3d = Populate3D(Region=box, Count=Slider(100, range=0..100), Seed=1)
ghpython_script = GhPythonScript(pointList=populate_3d)  # -> out, bounding_box; inputs pointList: list of Point3d
# ---------- ghpython_script: Python ----------
import Rhino.Geometry as rg

# get min and max values from input point list
data = pointList
x = sorted(data, key=lambda l: l[0])
x_max = x[0]
x_min = x[-1]
y = sorted(data, key=lambda l: l[1])
y_max = y[0]
y_min = y[-1]
z = sorted(data, key=lambda l: l[2])
z_max = z[0]
z_min = z[-1]

# construct 2 new points that a bounding box can be constructed from
p1 = rg.Point3d(x_min[0], y_min[1], z_min[2])
p2 = rg.Point3d(x_max[0], y_max[1], z_max[2])

# construct bounding box using these 2 points
box = rg.BoundingBox(p1, p2)

bounding_box = p1, p2, box
# ---------- end ghpython_script ----------
geometry = Geometry(ghpython_script.bounding_box)
